# Grasshopper definition GHBinaryWriter.gh (Grasshopper 1.0.7)
# plug-ins: ScriptParasite

number_slider = Slider(20, range=0..1000)
mesh_sphere = MeshSphere(Base=PlaneXY(0, 0, 0), Radius=Slider(5.8, range=0.1..10), UCount=number_slider, VCount=number_slider)
triangulate = Triangulate(Mesh=mesh_sphere)  # -> Mesh, Count
deconstruct_mesh = DeconstructMesh(Mesh=triangulate.Mesh)  # -> Vertices, Faces, Colours, Normals
list_length = ListLength(List=deconstruct_mesh.Vertices)
list_length_2 = ListLength(List=deconstruct_mesh.Faces)

file_path = FilePath("L:\source\repos\GHBinaryWriter\")
c_script = CSharpScript(meshInput=triangulate.Mesh)  # -> out, A; inputs meshInput: Mesh
# ---------- c_script: C# ----------
    string floatVertexArrayPath = "M:/vertexFloat.bin";
    string intFaceArrayPath = "M:/vertexInt.bin";

    float[] floatVertexArray = new float[meshInput.Vertices.Count * 3];
    int[] intFaceArray = new int[meshInput.Faces.Count * 3];

    for (int i = 0; i < meshInput.Vertices.Count; i++)
    {
      floatVertexArray[i * 3 + 0] = (float) meshInput.Vertices[i].X;
      floatVertexArray[i * 3 + 1] = (float) meshInput.Vertices[i].Y;
      floatVertexArray[i * 3 + 2] = (float) meshInput.Vertices[i].Z;
    }

    // Debug Print
    /*
    for(int i=0; i < floatVertexArray.Length; i++){
    Print(floatVertexArray[i].ToString());
    }
    */
    for (int i = 0; i < meshInput.Faces.Count; i++)
    {
      intFaceArray[i * 3 + 0] = (int) meshInput.Faces[i][0];
      intFaceArray[i * 3 + 1] = (int) meshInput.Faces[i][1];
      intFaceArray[i * 3 + 2] = (int) meshInput.Faces[i][2];
    }
    //Debug Print
    /*
    for(int i=0; i < intFaceArray.Length; i++){
    Print(intFaceArray[i].ToString());
    }
    */

    WriteFloatArraytoBin(floatVertexArray, floatVertexArrayPath);
    WriteIntArraytoBin(intFaceArray, intFaceArrayPath);

  }

  public void WriteFloatArraytoBin(float[] floatArray, string binPath)
  {
    using(System.IO.FileStream floatArrayFile = System.IO.File.Create(binPath, 1024))
    {
      using (System.IO.BinaryWriter writer = new System.IO.BinaryWriter(floatArrayFile))
      {
        foreach ( float value in floatArray)
        {
          writer.Write((float) value);
        }
        writer.Close();
      }
    }
  }

  public void WriteIntArraytoBin(int[] intArray, string binPath)
  {
    using(System.IO.FileStream intArrayFile = System.IO.File.Create(binPath, 1024))
    {
      using (System.IO.BinaryWriter writer = new System.IO.BinaryWriter(intArrayFile))
      {
        foreach ( int value in intArray)
        {
          writer.Write((int) value);
        }
        writer.Close();
      }
    }
# ---------- end c_script ----------
script_parasite = ScriptParasite(Enable=Toggle(True), Folder=file_path)

panel = Panel(list_length)
panel_2 = Panel(list_length_2)
panel_3 = Panel(c_script.out)
